# Grasshopper definition fresnel_shader.gh (Grasshopper 1.0.7)
# plug-ins: ghgl

number_slider = Slider(40, range=0..100)
msphere = MeshSphere(Base=PlaneXY(0, 0, 0), Radius=Slider(50, range=0..100), UCount=number_slider, VCount=number_slider)
demesh = DeconstructMesh(Mesh=msphere)  # -> Vertices, Faces, Colours, Normals
pdecon = Deconstruct(Point=demesh.Vertices)  # -> XComponent, YComponent, ZComponent
min = Minimum(A=pdecon.ZComponent, B=0)
max = Maximum(A=pdecon.ZComponent, B=0)
bnd = Bounds(Numbers=min)
bnd_2 = Bounds(Numbers=max)
dom = ConstructDomain(DomainStart=Slider(0.01, range=0..2), DomainEnd="1.0")
dom_2 = ConstructDomain(DomainStart="1.0", DomainEnd=Slider(1.22, range=0..2))
remap = RemapNumbers(Value=max, Source=bnd_2, Target=dom_2)  # -> Mapped, Clipped
remap_2 = RemapNumbers(Value=min, Source=bnd, Target=dom)  # -> Mapped, Clipped
multiplication = Multiplication(A=remap.Mapped, B=remap_2.Mapped)
scale_nu = ScaleNU(Geometry=demesh.Vertices, Plane=PlaneXY(0, 0, 0), ScaleX=1, ScaleY=1, ScaleZ=multiplication)  # -> Geometry, Transform
conmesh = ConstructMesh(Vertices=scale_nu.Geometry, Faces=demesh.Faces)
gl_mesh = GLMeshShader(
    M=conmesh,
    Fresnel_col=ColourSwatch(SwatchColor=RGB(255, 8, 8)),
    Ambient_col=ColourSwatch(SwatchColor=RGB(255, 255, 255)),
    Fresnel_power=Slider(0.8, range=0..10),
    Ambient_scale=Slider(1.8, range=0..10),
    DepthTestingEnabled=True,
    DepthWritingEnabled=True,
    DrawMode=4,
    FragmentShader="""#version 330

uniform vec3 _lightDirection[4];
uniform mat3 _worldToCameraNormal;
uniform vec4 fresnel_col;
uniform vec4 ambient_col;
uniform float fresnel_power;
uniform float ambient_scale;

in  vec3 normal;
in vec3 camera_dir;
out vec4 fragment_color;

void main() {
  float dotval = abs(dot(camera_dir, normal));
  float fresnelval = pow(1.0 - dotval, fresnel_power);
  
  float ambientval = pow(1.0 - dotval, fresnel_power * ambient_scale);
  vec3 col = mix(ambient_col.xyz, fresnel_col.xyz, 1.0 - ambientval);
  
  fragment_color = vec4(col, fresnelval);
}""",
    GLShader=(0, 2, 0),
    PreviewSortOrder=5,
    VertexShader="""#version 330

layout(location = 0) in vec3 _meshVertex;
layout(location = 1) in vec3 _meshNormal;

uniform mat4 _worldToClip;
uniform vec3 _cameraLocation;
out vec3 normal;
out vec3 camera_dir;

void main() {
  normal = _meshNormal;
  gl_Position = _worldToClip * vec4(_meshVertex , 1.0);
  camera_dir = normalize(_meshVertex - _cameraLocation);
}""",
    glLineWidth=3,
    glPointSize=8)  # -> Color, Depth
